# Grasshopper definition ExampleA.gh (Grasshopper 1.0.7)

length = GetNumber(Slider(39.48, range=11..40), AtLeast=1, AtMost=1, Maximum=1.797693135e+308, Minimum=-1.797693135e+308)
count = GetInteger(Slider(1, range=1..10), AtLeast=1, AtMost=1, Maximum=2147483647, Minimum=-2147483648)
radius = GetNumber(Slider(0.5, range=0..1), AtLeast=1, AtMost=1, Maximum=1.797693135e+308, Minimum=-1.797693135e+308)
rectangle = Rectangle(Plane=PlaneXY(0, 0, 0), XSize=length, YSize=Domain(-2, 2), Radius=0)  # -> Rectangle, Length
series = Series(Start=count, Step=radius, Count=count)
multiplication = Multiplication(A=series, B=0.5)
pop2d = Populate2D(Region=rectangle.Rectangle, Count=count, Seed=1)
ma = MassAddition(Input=multiplication)  # -> Result, PartialResults
cir = Circle(Plane=pop2d, Radius=ma.PartialResults)

# ---- group: RH_OUT:Curves
crv = Curve(cir)

# ---- group: RH_OUT:Circles
circle = Circle(cir)
