# Grasshopper definition ExampleC.gh (Grasshopper 1.0.7)

pt = Point(Point(-0.4579075579, -47.56564948, 0))
radius = GetNumber(Slider(2, range=2..10), AtLeast=1, AtMost=2147483647, Maximum=1.797693135e+308, Minimum=-1.797693135e+308)
length = GetNumber(Slider(40, range=10..40), AtLeast=1, AtMost=2147483647, Maximum=1.797693135e+308, Minimum=-1.797693135e+308)
points = GetGeometry(pt, AtLeast=1, AtMost=1, DeleteInput=False, Filter=1073741825)
cir = Circle(Plane=points, Radius=radius)
Z = UnitZ(Factor=length)
extr = Extrude(Base=cir, Direction=Z)
cap = CapHoles(Brep=extr)

# ---- group: RH_OUT:mesh
mesh = Mesh(cap)
