# Grasshopper definition ExampleD.gh (Grasshopper 1.0.7)

radius = GetNumber(Slider(2, range=0..2), AtLeast=1, AtMost=1, Maximum=1.797693135e+308, Minimum=-1.797693135e+308)
length = GetNumber(Slider(40, range=11..40), AtLeast=1, AtMost=1, Maximum=1.797693135e+308, Minimum=-1.797693135e+308)
points = GetPoint(AtLeast=1, AtMost=2147483647, Realtime=True)
cir = Circle(Plane=points, Radius=radius)
Z = UnitZ(Factor=length)
extr = Extrude(Base=cir, Direction=Z)
cap = CapHoles(Brep=extr)

# ---- group: RH_OUT:mesh
mesh = Mesh(cap)
