# Grasshopper definition FlatTruss.gh (Grasshopper 1.0.7)
# plug-ins: ArqueStructuresTools

length = GetNumber(Slider(5.5, range=0..10), AtLeast=5, AtMost=20, Maximum=20, Minimum=5, Prompt="Length")
truss_options = TrussOptions(
    TrussType="Warren",
    Width=length,
    Height=3,
    MaxHeight=4,
    HasClearHeight=True,
    ClearHeight=2.5,
    BaseType=0,
    ArticulationType="Rigid",
    Divisions=5,
    PorticoType="Truss",
    ColumnsCount=2)
construct_flat_truss = ConstructFlatTruss(Plane=PlaneXY(0, 0, 0), Options=truss_options)
deconstruct_truss = DeconstructTruss(Truss=construct_flat_truss)  # -> TopBeam, BottomBeam, IntermediateBeams, TopNodes, BottomNodes, StaticColumns, BoundaryColumns, BoundaryNodes
deconstruct_beam = DeconstructBeam(Beam=deconstruct_truss.TopBeam)  # -> Axis, Plane, Profile
deconstruct_beam_2 = DeconstructBeam(Beam=deconstruct_truss.BottomBeam)  # -> Axis, Plane, Profile
deconstruct_beam_3 = DeconstructBeam(Beam=deconstruct_truss.IntermediateBeams)  # -> Axis, Plane, Profile

# ---- group: RH_OUT:Top_Beams
curve = Curve(deconstruct_beam.Axis)

# ---- group: RH_OUT:Bottom_Beams
curve_2 = Curve(deconstruct_beam_2.Axis)

# ---- group: RH_OUT:Intermediate_Beams
curve_3 = Curve(deconstruct_beam_3.Axis)
