# Grasshopper definition Truss.gh (Grasshopper 1.0.7)
# plug-ins: ArqueStructuresTools

panel = Panel("""Arch
Doublepich
Monopich
Flat""")
subdivision_count = GetInteger(AtLeast=1, AtMost=2147483647, Maximum=2147483647, Minimum=-2147483648)
typology = GetInteger(AtLeast=0, AtMost=3, Maximum=3, Minimum=0, Prompt="Typology")
length = GetNumber(AtLeast=5, AtMost=20, Maximum=20, Minimum=5, Prompt="Length")
list_item = ListItem(List=panel, Index=typology, Wrap=True)
truss_options = TrussOptions(
    TrussType="Warren",
    Width=length,
    Height=3,
    MaxHeight=4,
    HasClearHeight=True,
    ClearHeight=2.5,
    BaseType=0,
    ArticulationType="Rigid",
    Divisions=subdivision_count,
    PorticoType="Truss",
    ColumnsCount=2)
series = Series(Start=0, Step=Slider(3, range=0..10), Count=Slider(3, range=0..10))
construct_point = ConstructPoint(XCoordinate=0, YCoordinate=series, ZCoordinate=0)
construct_truss = ConstructTruss(Typology=list_item, Plane=construct_point, Options=truss_options)
deconstruct_truss = DeconstructTruss(Truss=construct_truss)  # -> TopBeam, BottomBeam, IntermediateBeams, TopNodes, BottomNodes, StaticColumns, BoundaryColumns, BoundaryNodes
deconstruct_beam = DeconstructBeam(Beam=deconstruct_truss.BottomBeam)  # -> Axis, Plane, Profile
deconstruct_beam_2 = DeconstructBeam(Beam=deconstruct_truss.IntermediateBeams)  # -> Axis, Plane, Profile
deconstruct_column = DeconstructColumn(Column=deconstruct_truss.StaticColumns)  # -> Axis, Plane, Profile
deconstruct_beam_3 = DeconstructBeam(Beam=deconstruct_truss.TopBeam)  # -> Axis, Plane, Profile
cluster = Cluster(relay_2=deconstruct_truss.TopNodes, relay=deconstruct_beam_3.Axis)
cluster_2 = Cluster_2(relay=deconstruct_truss.BottomNodes, relay_2=deconstruct_beam.Axis)
curve = Curve(cluster)
curve_2 = Curve(cluster_2)
curve_3 = Curve(deconstruct_beam_2.Axis)
curve_4 = Curve(deconstruct_column.Axis)
pipe = Pipe(Curve=cluster, Radius=Slider(0.01, range=0..0.1), Caps=0)
pipe_2 = Pipe(Curve=curve_2, Radius=Slider(0.01, range=0..0.1), Caps=0)
pipe_3 = Pipe(Curve=curve_3, Radius=Slider(0.01, range=0..0.1), Caps=0)
pipe_4 = Pipe(Curve=curve_4, Radius=Slider(0.01, range=0..0.1), Caps=0)
cap_holes = CapHoles(Brep=pipe)
cap_holes_2 = CapHoles(Brep=pipe_2)
cap_holes_3 = CapHoles(Brep=pipe_3)
cap_holes_4 = CapHoles(Brep=pipe_4)
brep = Brep(cap_holes)
brep_2 = Brep(cap_holes_2)
brep_3 = Brep(cap_holes_3)
brep_4 = Brep(cap_holes_4)

# ---- group: RH_OUT:Top_Beams
mesh_brep = MeshBrep(
    Brep=brep,
    Settings={GridMaxCount=0, GridMinCount=16, JaggedSeams=False, MaxEdgeLength=0, MinEdgeLength=0.0001, MinTolerance=0, Refine=True, RefineAngle=0, RelativeTolerance=0.65, SimplePlanes=True, Tolerance=0})

# ---- group: RH_OUT:Bottom_Beams
mesh_brep_2 = MeshBrep(
    Brep=brep_2,
    Settings={GridMaxCount=0, GridMinCount=16, JaggedSeams=False, MaxEdgeLength=0, MinEdgeLength=0.0001, MinTolerance=0, Refine=True, RefineAngle=0, RelativeTolerance=0.65, SimplePlanes=True, Tolerance=0})

# ---- group: RH_OUT:Intermediate_Beams
mesh_brep_3 = MeshBrep(
    Brep=brep_3,
    Settings={GridMaxCount=0, GridMinCount=16, JaggedSeams=False, MaxEdgeLength=0, MinEdgeLength=0.0001, MinTolerance=0, Refine=True, RefineAngle=0, RelativeTolerance=0.65, SimplePlanes=True, Tolerance=0})

# ---- group: RH_OUT:Static_Columns
mesh_brep_4 = MeshBrep(
    Brep=brep_4,
    Settings={GridMaxCount=0, GridMinCount=16, JaggedSeams=False, MaxEdgeLength=0, MinEdgeLength=0.0001, MinTolerance=0, Refine=True, RefineAngle=0, RelativeTolerance=0.65, SimplePlanes=True, Tolerance=0})

# ==== cluster Cluster
relay = ClusterInput()
relay_2 = ClusterInput()
curve_closest_point = CurveClosestPoint(Point=relay_2, Curve=relay)  # -> Point, Parameter, Distance
shatter = Shatter(Curve=relay, Parameters=curve_closest_point.Parameter)
segments = ClusterOutput(shatter)

# ==== cluster Cluster_2
relay = ClusterInput()
relay_2 = ClusterInput()
curve_closest_point = CurveClosestPoint(Point=relay, Curve=relay_2)  # -> Point, Parameter, Distance
shatter = Shatter(Curve=relay_2, Parameters=curve_closest_point.Parameter)
segments = ClusterOutput(shatter)
